# Grasshopper definition 221_fabrication.ghx (Grasshopper 1.0.7)

# Design
brick_positions = GhPythonScript()  # -> brick_planes
# ---------- brick_positions: Python ----------
from compas.geometry import Frame, Point, Rotation
import math as m



"""Generates a COMPAS frames for each brick

This is where the design of the wall is created.

Returns
----------
brick_planes : [COMPAS Frame, COMPAS Frame, ...]

"""


VERTICAL_COUNT = 10
HORIZONTAL_COUNT = 5

# 0.031 x 0.016 x 0.0125

BRICK_LENGTH = 0.23
BRICK_HEIGHT = 0.05
GAP = 0.02

brick_planes = []

for i in range (VERTICAL_COUNT):
    for j in range (HORIZONTAL_COUNT):
        if i%2 ==0:
            x_pos = j * (BRICK_LENGTH + GAP)
            rot = m.radians(10)
            
        else:
            x_pos = j * (BRICK_LENGTH + GAP) + BRICK_LENGTH/2
            rot = m.radians(-10)
            
        z_pos = i * BRICK_HEIGHT
        
        origin = Point(x_pos, 0, z_pos)
        
        frame = Frame(origin, (1, 0, 0), (0, 1, 0))
        frame.transform(Rotation.from_axis_and_angle(frame.normal, rot, frame.point))
        brick_planes.append(frame)
# ---------- end brick_positions ----------
# Transform to fabrication frame
pt = Point(Point(3.075721055, 1.114069151, 0.005223249163))
beta = Slider(-180, range=-180..180)
alpha = Slider(0, range=-180..180)
# Add Obstacle (collision Mesh)
gamma = Slider(0, range=-180..180)
# Connect
connect = BooleanToggle(False)
# Define and Attatch Tool
load_robot = BooleanToggle(True)
xy = XYPlane(Origin=pt)
prot = RotatePlane(Plane=xy, Angle=Slider(-2.25, range=-3.14..3.14))
ros = ROSConnect(connect=connect)  # -> ros_client, is_connected; inputs port: Int32, connect: Boolean
#   port ip: The ip address ROS. Defaults to 127.0.0.1.
#   port port: The port of ROS. Defaults to 9090.
#   port connect: If True, connects to ROS. If False, disconnects from ROS. Defaults to False.
#   port ros_client: The ROS client.
#   port is_connected: True if connection established.
# ---------- ros: Python ----------
"""
Connect or disconnect to ROS.

COMPAS FAB v0.22.0
"""
from ghpythonlib.componentbase import executingcomponent as component
from scriptcontext import sticky as st

from compas_fab.backends import RosClient
from compas_fab.ghpython.components import create_id


class ROSConnect(component):
    def RunScript(self, ip, port, connect):
        ros_client = None

        ip = ip or '127.0.0.1'
        port = port or 9090

        key = create_id(self, 'ros_client')
        ros_client = st.get(key, None)

        if ros_client:
            st[key].close()
        if connect:
            st[key] = RosClient(ip, port)
            st[key].run(5)

        ros_client = st.get(key, None)
        is_connected = ros_client.is_connected if ros_client else False
        return (ros_client, is_connected)
# ---------- end ros ----------
bricks = GhPythonScript(positions=brick_positions)  # -> brick_pts, brick_meshes; inputs positions: list
# ---------- bricks: Python ----------
from compas.datastructures import Mesh
from compas.colors import Color
from compas.geometry import Box
import compas_ghpython

def brick(plane):
    """ List of points defining the corners of the brick 
    
    Returns
    ----------
    [pt0 : bottom point at negative x and negative y,
    pt1 : bottom point at negative x and possitive y,
    pt2 : bottom point at possitive x and possitve y,
    pt3 : bottom point at possitive x and negative y,
    pt4 : pt0 + Thickness,
    pt5 : pt1 + Thickness,
    pt6 : pt2 + Thickness,
    pt7 : pt3 + Thickness]
    """
    # 0.031x0.016x0.0125
    LENGTH = 0.23
    WIDTH = 0.11 
    HEIGHT = 0.05
    
    origin = plane.point
    
    x_vec = plane.xaxis
    y_vec = plane.yaxis 
    z_vec = plane.normal

    pt_0 = origin - (x_vec *LENGTH/2) - (y_vec*WIDTH/2)
    pt_1 = origin + (x_vec *LENGTH/2) - (y_vec*WIDTH/2)
    pt_2 = origin + (x_vec *LENGTH/2) + (y_vec*WIDTH/2)
    pt_3 = origin - (x_vec *LENGTH/2) + (y_vec*WIDTH/2)
    
    pt_4 = pt_0 + (z_vec*HEIGHT)
    pt_5 = pt_1 + (z_vec*HEIGHT)
    pt_6 = pt_2 + (z_vec*HEIGHT)
    pt_7 = pt_3 + (z_vec*HEIGHT)
    
    pts = [pt_0, pt_1, pt_2, pt_3, pt_4, pt_5, pt_6, pt_7]
    
    
    
    return pts

    
def mesh(m_pts):
    """Mesh  depicting the brick:

    Returns
    ----------
    mesh_brick : Mesh
    """
    box = Box.from_bounding_box(m_pts)
    mesh_brick = Mesh.from_shape(box)
    return mesh_brick


brick_meshes = []
brick_frames = positions

for pos in positions:
    brick_pts = brick(pos)
    brick_mesh = mesh(brick_pts)

    vertices, faces = brick_mesh.to_vertices_and_faces()
    brick_meshes.append(compas_ghpython.draw_mesh(vertices, faces, color=Color(0.9, 0.6, .2, .5).rgba255))
# ---------- end bricks ----------
euler_angles = GhPythonScript(
    X=Slider(0, range=-1000..1000),
    Y=Slider(0, range=-1000..1000),
    Z=Slider(360, range=-1000..1000),
    A=alpha,
    B=beta,
    C=gamma)  # -> F
# ---------- euler_angles: Python ----------
import math
from compas.geometry import Rotation
from compas.geometry import Frame
from compas.geometry import Translation
R = Rotation.from_euler_angles([math.radians(A), math.radians(B), math.radians(C)], False, 'zyx')
T = Translation.from_vector((X/1000,Y/1000,Z/1000))
F = Frame.worldXY().transformed(T * R)
# ---------- end euler_angles ----------
mesh = Mesh(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)
mesh_2 = Mesh(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)
transform = GhPythonScript(brick_plane=brick_positions, target=prot)  # -> target_frame
# ---------- transform: Python ----------
from compas.geometry import Frame, Transformation
from compas_rhino.conversions import RhinoPlane

f = RhinoPlane.from_geometry(target).to_compas_frame()
T = Transformation.from_frame(f)

brick_plane = RhinoPlane.from_geometry(brick_plane).to_compas_frame()
target_frame = brick_plane.transformed(T)
# ---------- end transform ----------
draw = Draw(cg=euler_angles)  # -> rg
#   port cg: The COMPAS geometry or datastructure to be drawn.
#   port rg: The Rhino geometry object.
# ---------- draw: Python ----------
"""
Draws COMPAS geometry in Grasshopper.
"""
from ghpythonlib.componentbase import executingcomponent as component

from compas.artists import Artist


class CompasToRhinoGeometry(component):
    def RunScript(self, cg):
        if not cg:
            return None

        return Artist(cg).draw()
# ---------- end draw ----------
mesh_3 = Mesh(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)
mesh_4 = Mesh(bricks.brick_meshes)
robot = ROSRobot(ros_client=ros.ros_client, load=load_robot)  # -> robot; inputs load: Boolean
#   port ros_client: The ROS client.
#   port load: If True, loads the robot from ROS. Defaults to False.
# ---------- robot: Python ----------
"""
Load robot directly from ROS.

COMPAS FAB v0.22.0
"""
from compas_ghpython.artists import RobotModelArtist
from ghpythonlib.componentbase import executingcomponent as component
from scriptcontext import sticky as st

from compas_fab.ghpython.components import create_id


class ROSRobot(component):
    def RunScript(self, ros_client, load):
        key = create_id(self, 'robot')

        if ros_client and ros_client.is_connected and load:
            # Load URDF from ROS
            st[key] = ros_client.load_robot(load_geometry=True, precision='12f')
            st[key].artist = RobotModelArtist(st[key].model)

        robot = st.get(key, None)
        if robot:  # client sometimes need to be restarted, without needing to reload geometry
            robot.client = ros_client
        return robot
# ---------- end robot ----------
tool = AttachedTool(robot=robot, visual_mesh=mesh, collision_mesh=mesh_2, tcf_plane=draw)  # -> robot; inputs visual_mesh: Mesh, collision_mesh: Mesh
#   port visual_mesh: A visual mesh for the tool.
#   port collision_mesh: A collision mesh for the tool.
#   port tcf_plane: The frame of the tool in tool0 frame.
#   port group: The planning group to which the tool should be attached.
# ---------- tool: Python ----------
"""
Attach a tool to the robot.

COMPAS FAB v0.27.0
"""
from ghpythonlib.componentbase import executingcomponent as component
from compas_rhino.conversions import RhinoMesh
from compas_rhino.conversions import plane_to_compas_frame

from compas.geometry import Frame
from compas_fab.robots import Tool


class AttachToolComponent(component):
    def RunScript(self, robot, visual_mesh, collision_mesh, tcf_plane, group):
        if robot and robot.client and robot.client.is_connected and visual_mesh:
            if not collision_mesh:
                collision_mesh = visual_mesh

            c_visual_mesh = RhinoMesh.from_geometry(visual_mesh).to_compas()
            c_collision_mesh = RhinoMesh.from_geometry(collision_mesh).to_compas()

            if not tcf_plane:
                frame = Frame.worldXY()
            else:
                frame = plane_to_compas_frame(tcf_plane)
            tool = Tool(c_visual_mesh, frame, c_collision_mesh)

            robot.attach_tool(tool, group)

        return robot
# ---------- end tool ----------
scene = PlanningScene(robot=tool)  # -> scene
#   port scene: A planning scene.
# ---------- scene: Python ----------
"""
Create a planning scene.

COMPAS FAB v0.27.0
"""
from ghpythonlib.componentbase import executingcomponent as component
from scriptcontext import sticky as st

from compas_fab.ghpython.components import create_id
from compas_fab.robots import PlanningScene


class PlanningSceneComponent(component):
    def RunScript(self, robot):
        key = create_id(self, 'planning_scene')
        if robot:
            st[key] = PlanningScene(robot)
        return st.get(key, None)
# ---------- end scene ----------
cm = CollisionMesh(scene=scene, mesh=mesh_3, identifier="obstacle", add=Button(), remove=Button())  # -> ok; inputs mesh: Mesh, add: Boolean, append: Boolean, remove: Boolean
#   port scene: The planning scene.
#   port mesh: A collision mesh.
#   port identifier: The identifier of the collision mesh.
#   port add: If True, adds the collision mesh to the planning scene.
#   port append: If True, appends the collision mesh to the planning scene.
#   port remove: If True, removes the collision mesh from the planning scene.
#   port ok: True if the operation was successfully performed.
# ---------- cm: Python ----------
"""
Add or remove a collision mesh from the planning scene.

COMPAS FAB v0.27.0
"""
from compas_rhino.geometry import RhinoMesh
from ghpythonlib.componentbase import executingcomponent as component

from compas_fab.robots import CollisionMesh


class CollisionMeshComponent(component):
    def RunScript(self, scene, M, name, add, append, remove):
        ok = False
        self.Message = ""

        if (add and append) or (append and remove) or (add and remove):
            self.Message = "Use only one operation at a time\n(add, append or remove)"
            raise Exception(self.Message)

        if scene and M and name:
            mesh = RhinoMesh.from_geometry(M).to_compas()
            collision_mesh = CollisionMesh(mesh, name)
            if add:
                scene.add_collision_mesh(collision_mesh)
                self.Message = "Added"
                ok = True
            if append:
                scene.append_collision_mesh(collision_mesh)
                self.Message = "Appended"
                ok = True
            if remove:
                scene.remove_collision_mesh(name)
                self.Message = "Removed"
                ok = True
        return ok
# ---------- end cm ----------
bricks_2 = GhPythonScript(positions=transform)  # -> brick_pts, brick_meshes; inputs positions: list; same code as bricks
draw_2 = Draw(cg=transform)  # -> rg; same code as draw
# Fabrication (Pick a brick)
number_slider = Slider(10, range=0..10)
int = Integer(number_slider)
item = ListItem(List=draw_2, Index=int, Wrap=True)
split = SplitList(List=bricks_2.brick_meshes, Index=int)  # -> ListA, ListB
# Initial position
number_slider_2 = Slider(90, range=-185..185)
# Pickup
e1 = Slider(0, range=0..4100)
# Place
panel = Panel("0.15")
Z = UnitZ(Factor=panel)
pln = Plane(Plane(origin=(0.04512148731, 0.8664994322, 0.2765276512), x=(0.005223306083, -0.9999863584, -1.839999993e-06), y=(0.9999863544, 0.005223306227, -9.014999988e-05)))
Z_2 = UnitZ(Factor="0.15")
python = GhPythonScript(
    a1=number_slider_2,
    a2=Slider(-80, range=-140..-5),
    a3=Slider(110, range=-120..155),
    a4=Slider(0, range=-350..350),
    a5=Slider(40, range=-122.5..125),
    a6=Slider(0, range=-350..350),
    e1=e1)  # -> joint_value
# ---------- python: Python ----------
from math import radians

joint_value = (e1/1000,radians(a1),radians(a2),radians(a3),radians(a4),radians(a5),radians(a6))
# ---------- end python ----------
move = Move(Geometry=pln, Motion=Z)  # -> Geometry, Transform
move_2 = Move(Geometry=item, Motion=Z_2)  # -> Geometry, Transform
python_2 = GhPythonScript(robot=robot, joint_value=python)  # -> config; inputs joint_value: list
# ---------- python_2: Python ----------
config = robot.zero_configuration()
config.joint_values = joint_value
# ---------- end python_2 ----------
constraints_from_plane = ConstraintsFromPlane(robot=tool, plane=move_2.Geometry, group="west_robot_eax")  # -> constraints
#   port plane: The plane or frame from which we create position and orientation constraints.
#   port group: The planning group for which we specify the constraint. Defaults to the robot's main planning group.
#   port tolerance_position: The allowed tolerance to the frame's position (defined in the robot's units). Defaults to 0.001
#   port tolerance_xaxis: The allowed tolerance of the frame's X-axis in degrees.
#   port tolerance_yaxis: The allowed tolerance of the frame's Y-axis in degrees.
#   port tolerance_zaxis: The allowed tolerance of the frame's Z-axis in degrees.
#   port constraints: A list containing a position and an orientation constraint.
# ---------- constraints_from_plane: Python ----------
"""
Create a position and an orientation constraint from a plane calculated for the group's end-effector link.

COMPAS FAB v0.27.0
"""
import math

from compas_rhino.conversions import RhinoPlane
from ghpythonlib.componentbase import executingcomponent as component


class ConstraintsFromPlane(component):
    def RunScript(self, robot, plane, group, tolerance_position, tolerance_xaxis, tolerance_yaxis, tolerance_zaxis):
        goal_constraints = None
        if robot and plane:
            tolerance_position = tolerance_position or 0.001
            tolerance_xaxis = tolerance_xaxis or 1.
            tolerance_yaxis = tolerance_yaxis or 1.
            tolerance_zaxis = tolerance_zaxis or 1.

            frame = RhinoPlane.from_geometry(plane).to_compas_frame()
            tolerances_axes = [math.radians(tolerance_xaxis), math.radians(tolerance_yaxis), math.radians(tolerance_zaxis)]
            goal_constraints = robot.constraints_from_frame(frame, tolerance_position, tolerances_axes, group)

        return goal_constraints
# ---------- end constraints_from_plane ----------
# To pickup
plan_cartesian_motion = PlanCartesianMotion(robot=tool, planes=move.Geometry, start_configuration=python_2, group="west_robot_eax", compute=Button())  # -> trajectory; inputs planes: list, attached_collision_meshes: list, path_constraints: list, compute: Boolean
#   port planes: The planes or frames through which the path is defined.
#   port start_configuration: The robot's full configuration, i.e. values for all configurable joints of the entire robot, at the starting position. Defaults to the all-zero configuration.
#   port group: The planning group used for calculation. Defaults to the robot's main planning group.
#   port attached_collision_meshes: A list of attached collision meshes to be included for planning.
#   port path_constraints: Optional constraints that can be imposed along the solution path. Note that path calculation won't work if the start_configuration violates these constraints. Defaults to None.
#   port max_step: The approximate distance between the calculated points. (Defined in the robot's units.) Defaults to 0.01.
#   port compute: If True, calculates a trajectory.
#   port trajectory: The calculated trajectory.
# ---------- plan_cartesian_motion: Python ----------
"""
Calculate a cartesian motion path (linear in tool space).

COMPAS FAB v0.27.0
"""
from compas_rhino.conversions import RhinoPlane
from ghpythonlib.componentbase import executingcomponent as component
from scriptcontext import sticky as st

from compas_fab.ghpython.components import create_id


class PlanCartesianMotion(component):
    def RunScript(self, robot, planes, start_configuration, group, attached_collision_meshes, path_constraints, max_step, compute):

        key = create_id(self, 'trajectory')

        max_step = float(max_step) if max_step else 0.01
        path_constraints = list(path_constraints) if path_constraints else None
        attached_collision_meshes = list(attached_collision_meshes) if attached_collision_meshes else None

        if robot and robot.client and robot.client.is_connected and start_configuration and planes and compute:
            frames = [RhinoPlane.from_geometry(plane).to_compas_frame() for plane in planes]
            st[key] = robot.plan_cartesian_motion(frames,
                                                  start_configuration=start_configuration,
                                                  group=group,
                                                  options=dict(
                                                      max_step=max_step,
                                                      path_constraints=path_constraints,
                                                      attached_collision_meshes=attached_collision_meshes
                                                  ))

        trajectory = st.get(key, None)
        return trajectory
# ---------- end plan_cartesian_motion ----------
trajectory_visualize = TrajectoryVisualize(robot=tool, group="west_robot_eax", trajectory=plan_cartesian_motion)  # -> start_configuration, configurations, fraction, time, planes, P, V, A
#   port group: The planning group for which this trajectory was planned.
#   port trajectory: The calculated trajectory.
#   port start_configuration: The start configuration of the trajectory.
#   port configurations: The full configurations along the trajectory.
#   port fraction: Indicates the fraction of requested trajectory that was calculated, e.g. 1 means the full trajectory was found.
#   port time: The time which is needed to execute that trajectory at full speed.
#   port planes: The planes of the robot's end-effector.
#   port P: The positions along the trajectory
#   port V: The velocities along the trajectory
#   port A: The accelerations along the trajectory
# ---------- trajectory_visualize: Python ----------
"""
Visualizes a trajectory.

COMPAS FAB v0.27.0
"""
from compas_ghpython import draw_frame
from compas_ghpython import list_to_ghtree
from ghpythonlib.componentbase import executingcomponent as component


class TrajectoryVisualize(component):
    def RunScript(self, robot, group, trajectory):
        start_configuration = None
        configurations = []
        fraction = 0.
        time = 0.

        planes = []
        positions = []
        velocities = []
        accelerations = []

        if robot and trajectory:
            group = group or robot.main_group_name

            for c in trajectory.points:
                configurations.append(robot.merge_group_with_full_configuration(c, trajectory.start_configuration, group))
                frame = robot.forward_kinematics(c, group, options=dict(solver='model'))
                planes.append(draw_frame(frame))
                positions.append(c.positions)
                velocities.append(c.velocities)
                accelerations.append(c.accelerations)

            start_configuration = trajectory.start_configuration
            fraction = trajectory.fraction
            time = trajectory.time_from_start

        P = list_to_ghtree(list(zip(*positions)))
        V = list_to_ghtree(list(zip(*velocities)))
        A = list_to_ghtree(list(zip(*accelerations)))

        # return outputs if you have them; here I try it for you:
        return (start_configuration, configurations, fraction, time, planes, P, V, A)
# ---------- end trajectory_visualize ----------
item_2 = ListItem(List=trajectory_visualize.configurations, Index=-1, Wrap=True)
# Pickup approach
plan_cartesian_motion_2 = PlanCartesianMotion(robot=tool, planes=pln, start_configuration=item_2, group="west_robot_eax", compute=Toggle(True))  # -> trajectory; inputs planes: list, attached_collision_meshes: list, path_constraints: list, compute: Boolean; same code as plan_cartesian_motion
trajectory_visualize_2 = TrajectoryVisualize(robot=tool, group="west_robot_eax", trajectory=plan_cartesian_motion_2)  # -> start_configuration, configurations, fraction, time, planes, P, V, A; same code as trajectory_visualize
item_3 = ListItem(List=trajectory_visualize_2.configurations, Index=-1, Wrap=True)
# Back to pickup
plan_cartesian_motion_3 = PlanCartesianMotion(robot=tool, planes=move.Geometry, start_configuration=item_3, group="west_robot_eax", compute=Toggle(True))  # -> trajectory; inputs planes: list, attached_collision_meshes: list, path_constraints: list, compute: Boolean; same code as plan_cartesian_motion
trajectory_visualize_3 = TrajectoryVisualize(robot=tool, group="west_robot_eax", trajectory=plan_cartesian_motion_3)  # -> start_configuration, configurations, fraction, time, planes, P, V, A; same code as trajectory_visualize
item_4 = ListItem(List=trajectory_visualize_3.configurations, Index=-1, Wrap=True)
# Traverse to place
plan_motion = PlanMotion(
    robot=tool,
    goal_constraints=constraints_from_plane,
    start_configuration=item_4,
    group="west_robot_eax",
    compute=Toggle(True))  # -> trajectory; inputs goal_constraints: list, attached_collision_meshes: list, path_constraints: list, compute: Boolean
#   port goal_constraints: The goal to be achieved, defined in a set of constraints. Constraints can be very specific, for example defining value domains for each joint, such that the goal configuration is included, or defining a volume in space, to which a specific robot link (e.g. the end-effector) is required to move to.
#   port start_configuration: The robot's full configuration, i.e. values for all configurable joints of the entire robot, at the starting position. Defaults to the all-zero configuration.
#   port group: The planning group used for calculation. Defaults to the robot's main planning group.
#   port attached_collision_meshes: A list of attached collision meshes to be included for planning.
#   port path_constraints: Optional constraints that can be imposed along the solution path. Note that path calculation won't work if the start_configuration violates these constraints. Defaults to None.
#   port planner_id: The name of the algorithm used for path planning. Defaults to 'RRTConnect'
#   port compute: If True, calculates a trajectory.
#   port trajectory: The calculated trajectory.
# ---------- plan_motion: Python ----------
"""
Calculate a motion path.

COMPAS FAB v0.27.0
"""
from ghpythonlib.componentbase import executingcomponent as component
from scriptcontext import sticky as st

from compas_fab.ghpython.components import create_id


class PlanMotion(component):
    def RunScript(self, robot, goal_constraints, start_configuration, group, attached_collision_meshes, path_constraints, planner_id, compute):

        key = create_id(self, 'trajectory')

        path_constraints = list(path_constraints) if path_constraints else None
        attached_collision_meshes = list(attached_collision_meshes) if attached_collision_meshes else None
        planner_id = str(planner_id) if planner_id else 'RRTConnect'

        if robot and robot.client and robot.client.is_connected and start_configuration and goal_constraints and compute:
            st[key] = robot.plan_motion(goal_constraints,
                                        start_configuration=start_configuration,
                                        group=group,
                                        options=dict(
                                            attached_collision_meshes=attached_collision_meshes,
                                            path_constraints=path_constraints,
                                            planner_id=planner_id,
                                        ))

        trajectory = st.get(key, None)
        return trajectory
# ---------- end plan_motion ----------
trajectory_visualize_4 = TrajectoryVisualize(robot=tool, group="west_robot_eax", trajectory=plan_motion)  # -> start_configuration, configurations, fraction, time, planes, P, V, A; same code as trajectory_visualize
item_5 = ListItem(List=trajectory_visualize_4.configurations, Index=-1, Wrap=True)
# Place approach
plan_cartesian_motion_4 = PlanCartesianMotion(robot=tool, planes=item, start_configuration=item_5, group="west_robot_eax", compute=Toggle(True))  # -> trajectory; inputs planes: list, attached_collision_meshes: list, path_constraints: list, compute: Boolean; same code as plan_cartesian_motion
trajectory_visualize_5 = TrajectoryVisualize(robot=tool, group="west_robot_eax", trajectory=plan_cartesian_motion_4)  # -> start_configuration, configurations, fraction, time, planes, P, V, A; same code as trajectory_visualize
item_6 = ListItem(List=trajectory_visualize_5.configurations, Index=-1, Wrap=True)
# Go back to place
plan_cartesian_motion_5 = PlanCartesianMotion(robot=tool, planes=move_2.Geometry, start_configuration=item_6, group="west_robot_eax", compute=Toggle(True))  # -> trajectory; inputs planes: list, attached_collision_meshes: list, path_constraints: list, compute: Boolean; same code as plan_cartesian_motion
trajectory_visualize_6 = TrajectoryVisualize(robot=tool, group="west_robot_eax", trajectory=plan_cartesian_motion_5)  # -> start_configuration, configurations, fraction, time, planes, P, V, A; same code as trajectory_visualize
entwine = Entwine(
    Branch00=trajectory_visualize.configurations,
    Branch01=trajectory_visualize_2.configurations,
    Branch02=trajectory_visualize_3.configurations,
    Branch03=trajectory_visualize_4.configurations,
    Branch04=trajectory_visualize_5.configurations,
    Branch05=trajectory_visualize_6.configurations,
    FlattenInputs=True)  # -> flatten(Result)
entwine_2 = Entwine(
    Branch00=trajectory_visualize.planes,
    Branch01=trajectory_visualize_2.planes,
    Branch02=trajectory_visualize_3.planes,
    Branch03=trajectory_visualize_4.planes,
    Branch04=trajectory_visualize_5.planes,
    Branch05=trajectory_visualize_6.planes,
    FlattenInputs=True)  # -> flatten(Result)
python_3 = GhPythonScript(configs=entwine, progress=Slider(0, range=0..1))  # -> config; inputs configs: list
# ---------- python_3: Python ----------
config = configs[int(progress * (len(configs)-1))]
# ---------- end python_3 ----------

# ----
# Visualization
robot_visualize = RobotVisualize(robot=tool, configuration=python_3)  # -> visual, collision, collision_meshes, attached_meshes, frames, base_frame, ee_frame; inputs show_visual: Boolean, show_collision: Boolean, show_frames: Boolean, show_base_frame: Boolean, show_end_effector_frame: Boolean, show_cm: Boolean, show_acm: Boolean
#   port group: The planning group used for end-effector and base visualization.
#   port configuration: The robot's full configuration.
#   port show_visual: Whether or not to show the robot's visual meshes.
#   port show_collision: Whether or not to show the robot's collision meshes.
#   port show_frames: Whether or not to show the robot's joint frames.
#   port show_base_frame: Whether or not to show the robot's base frame.
#   port show_end_effector_frame: Whether or not to show the robot's end-effector frame.
#   port show_cm: Whether or not to show the collision meshes (if any).
#   port show_acm: Whether or not to show the attached collision meshes (if any).
#   port visual: Rhino meshes of the robot's visual geometry (if any).
#   port collision: Rhino meshes of the robot's collision geometry (if any).
#   port collision_meshes: Rhino meshes of the scene's collision meshes (if any).
#   port attached_meshes: Rhino meshes of the scene's attached collision meshes (if any).
#   port frames: The robot's joint frames as Rhino planes (if any).
#   port base_frame: The robot's base frame as a Rhino plane (if any).
#   port ee_frame: The robot's end-effector frame as a Rhino plane (if any).
# ---------- robot_visualize: Python ----------
"""
Visualizes the robot.

COMPAS FAB v0.27.0
"""
from compas.artists import Artist
from compas.geometry import Frame
from compas.geometry import Transformation
from compas_fab.robots import PlanningScene
from ghpythonlib.componentbase import executingcomponent as component


class RobotVisualize(component):
    def RunScript(
        self,
        robot,
        group,
        configuration,
        show_visual,
        show_collision,
        show_frames,
        show_base_frame,
        show_end_effector_frame,
        show_cm,
        show_acm,
    ):

        visual = None
        collision = None
        collision_meshes = None
        attached_meshes = None
        frames = None
        base_frame = None
        ee_frame = None

        if robot:
            show_visual = True if show_visual is None else show_visual
            show_cm = True if show_cm is None else show_cm
            show_acm = True if show_acm is None else show_acm
            configuration = configuration or robot.zero_configuration()

            robot.update(configuration, visual=show_visual, collision=show_collision)
            compas_frames = robot.transformed_frames(configuration, group)

            if show_visual:
                visual = robot.artist.draw_visual()

            if show_collision:
                collision = robot.artist.draw_collision()

            if show_base_frame:
                base_compas_frame = compas_frames[0]
                artist = Artist(base_compas_frame)
                base_frame = artist.draw()

            if show_end_effector_frame:
                ee_compas_frame = robot.forward_kinematics(
                    configuration, group, options=dict(solver="model")
                )
                artist = Artist(ee_compas_frame)
                ee_frame = artist.draw()

            if show_frames:
                frames = []
                for compas_frame in compas_frames[1:]:
                    artist = Artist(compas_frame)
                    frame = artist.draw()
                    frames.append(frame)

            if show_cm or show_acm:
                scene = PlanningScene(robot)
                scene = robot.client.get_planning_scene()

                collision_meshes = []
                attached_meshes = []

                if show_cm:
                    for co in scene.world.collision_objects:
                        header = co.header
                        frame_id = header.frame_id
                        cms = co.to_collision_meshes()

                        for cm in cms:
                            if cm.frame != Frame.worldXY():
                                t = Transformation.from_frame(cm.frame)
                                mesh = cm.mesh.transformed(t)
                            else:
                                mesh = cm.mesh

                            collision_meshes.append(Artist(mesh).draw())

                if show_acm:
                    for aco in scene.robot_state.attached_collision_objects:
                        for acm in aco.to_attached_collision_meshes():
                            frame_id = aco.object["header"]["frame_id"]
                            frame = robot.forward_kinematics(
                                configuration, options=dict(link=frame_id)
                            )
                            t = Transformation.from_frame(frame)

                            # Local CM frame
                            if (
                                acm.collision_mesh.frame
                                and acm.collision_mesh.frame != Frame.worldXY()
                            ):
                                t = t * Transformation.from_frame(
                                    acm.collision_mesh.frame
                                )

                            mesh = acm.collision_mesh.mesh.transformed(t)

                            attached_meshes.append(Artist(mesh).draw())

        return (
            visual,
            collision,
            collision_meshes,
            attached_meshes,
            frames,
            base_frame,
            ee_frame,
        )
# ---------- end robot_visualize ----------
mesh_5 = Mesh(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)
mesh_6 = Mesh(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)
mesh_7 = Mesh(split.ListA)
demesh = DeconstructMesh(Mesh=robot_visualize.visual)  # -> Vertices, Faces, Colours, Normals
demesh_2 = DeconstructMesh(Mesh=robot_visualize.collision_meshes)  # -> Vertices, Faces, Colours, Normals
demesh_3 = DeconstructMesh(Mesh=mesh_7)  # -> Vertices, Faces, Colours, Normals
conmesh = ConstructMesh(Vertices=demesh.Vertices, Faces=demesh.Faces)
conmesh_2 = ConstructMesh(Vertices=demesh_2.Vertices, Faces=demesh_2.Faces)
conmesh_3 = ConstructMesh(Vertices=demesh_3.Vertices, Faces=demesh_3.Faces)
relay = Relay([conmesh, mesh_5, mesh_6])
medges = MeshEdges(Mesh=relay)  # -> NakedEdges, InteriorEdges, NonManifoldEdges
medges_2 = MeshEdges(Mesh=conmesh_2)  # -> NakedEdges, InteriorEdges, NonManifoldEdges
medges_3 = MeshEdges(Mesh=conmesh_3)  # -> NakedEdges, InteriorEdges, NonManifoldEdges
pline = PolyLine(Vertices=entwine_2, Closed=False)
preview = CustomPreview(Geometry=relay, Material=ColourSwatch(SwatchColor=RGB(255, 255, 255)))
preview_2 = CustomPreview(Geometry=medges.InteriorEdges, Material=ColourSwatch(SwatchColor=RGB(0, 0, 0)))
preview_3 = CustomPreview(Geometry=conmesh_2, Material=ColourSwatch(SwatchColor=RGB(255, 163, 163)))
preview_4 = CustomPreview(Geometry=medges_2.InteriorEdges, Material=ColourSwatch(SwatchColor=RGB(0, 0, 0)))
preview_5 = CustomPreview(Geometry=conmesh_3, Material=ColourSwatch(SwatchColor=RGB(188, 237, 161)))
preview_6 = CustomPreview(Geometry=medges_3.InteriorEdges, Material=ColourSwatch(SwatchColor=RGBA(0, 0, 0, 148)))

mesh_8 = Mesh(split.ListB)
demesh_4 = DeconstructMesh(Mesh=mesh_8)  # -> Vertices, Faces, Colours, Normals
conmesh_4 = ConstructMesh(Vertices=demesh_4.Vertices, Faces=demesh_4.Faces)
medges_4 = MeshEdges(Mesh=conmesh_4)  # -> NakedEdges, InteriorEdges, NonManifoldEdges
preview_7 = CustomPreview(Geometry=medges_4.InteriorEdges, Material=ColourSwatch(SwatchColor=RGBA(0, 0, 0, 148)))
preview_8 = CustomPreview(Geometry=conmesh_4, Material=ColourSwatch(SwatchColor=RGBA(237, 161, 161, 69)))
