# Grasshopper definition 0_basic_setup.ghx (Grasshopper 1.0.7)
# plug-ins: KUKA|prc - parametric robot control

# ----
# Commands
pt = Point(Point(1586.277539, -478.4588222, 1317.927582))
ptp_move = PTPMovementKUKAPrc(TargetAsPlane=pt, extaxenabled=False, interpolation="C_PTP")

# ----
# Raccoon KUKA Robot Programming Tutorial
# Basic Setup
# Simulation Progress
number_slider = Slider(1, range=0..1)

# ----
# Robot Model
kr90_kr270_r2500 = QuantecKR90KR270R2500Robot(infiniterot=False)

# ----
# Core Component
# Richt click to toggle options.
# 
# Double Click to view/set more detailed options.
kuka_prc = KUKAPrcCORE(
    SimulationSlider=number_slider,
    KUKAPrcCommands=ptp_move,
    Robot=kr90_kr270_r2500,
    PRC_BaseExpose=False,
    PRC_SaveNameExpose=False,
    PRCsettings="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")  # -> RobotGeometry, AnalysisOutput
