# Grasshopper definition 1_KUKA_frame.ghx (Grasshopper 1.0.7)
# plug-ins: KUKA|prc - parametric robot control

# Raccoon KUKA Robot Programming Tutorial
# KUKA Frame
number_slider = Slider(0, range=-2000..2000)

# ----
# Rotate around Z-axis
number_slider_2 = Slider(0, range=-180..180)

# ----
# Rotate around Y-axis
number_slider_3 = Slider(0, range=-180..180)

# ----
# Rotate around X-axis
number_slider_4 = Slider(0, range=-180..180)

frame = FrameKUKAPrc(
    FrameNumber=0,
    XValue=number_slider,
    YValue=Slider(0, range=-2000..2000),
    ZValue=Slider(0, range=0..2000),
    AValue=number_slider_2,
    BValue=number_slider_3,
    CValue=number_slider_4,
    toolaxis="Z")  # -> KUKAPrcFrame, XYZABCAsPlane
