# Grasshopper definition 2_robot_tool.ghx (Grasshopper 1.0.7)
# plug-ins: KUKA|prc - parametric robot control

# ---- group: Flange
frame = FrameKUKAPrc(FrameNumber=0, XValue="0", YValue="0", ZValue="0", AValue="0", BValue="0", CValue="0", toolaxis="X")  # -> KUKAPrcFrame, XYZABCAsPlane
custom_tool_pln = CustomToolPlaneKUKAPrc(ToolNumber="3", ToolPlane=frame.XYZABCAsPlane, frameinput=False)

# ---- group: Gripper
gripper_mesh = Mesh(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)
frame_2 = FrameKUKAPrc(FrameNumber=0, XValue="0", YValue="0", ZValue="360", AValue="0", BValue="-90", CValue="0", toolaxis="X")  # -> KUKAPrcFrame, XYZABCAsPlane
custom_tool_pln_2 = CustomToolPlaneKUKAPrc(ToolGeometry=gripper_mesh, ToolNumber="4", ToolPlane=frame_2.XYZABCAsPlane, frameinput=False)

# ----
spindle_mesh = Mesh(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)
frame_3 = FrameKUKAPrc(FrameNumber=0, XValue="1.354", YValue="-373.390", ZValue="236.426", AValue="-90", BValue="0", CValue="90", toolaxis="X")  # -> KUKAPrcFrame, XYZABCAsPlane
custom_tool_pln_3 = CustomToolPlaneKUKAPrc(ToolGeometry=spindle_mesh, ToolNumber="7", ToolPlane=frame_3.XYZABCAsPlane, frameinput=False)

# ----
# Raccoon KUKA Robot Programming Tutorial
# Robot Tool
kr90_kr270_r2500 = QuantecKR90KR270R2500Robot(infiniterot=False)
list = ValueList({"Flange": 0, "Gripper": 1, "Spindle": 2}, selected="Gripper")
ptp_move = PTPMovementKUKAPrc(TargetAsPlane=PlaneXZ(1541.747393, -148.641443, 1635.909168), extaxenabled=False, interpolation="C_PTP")
filter = StreamFilter(Gate=list, Stream0=custom_tool_pln, Stream1=custom_tool_pln_2, Stream2=custom_tool_pln_3)
kuka_prc = KUKAPrcCORE(
    SimulationSlider=1,
    KUKAPrcCommands=ptp_move,
    Tool=filter,
    Robot=kr90_kr270_r2500,
    PRC_BaseExpose=False,
    PRC_SaveNameExpose=False,
    PRCsettings="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")  # -> RobotGeometry, AnalysisOutput
