# Grasshopper definition 3_robot_motions_I.ghx (Grasshopper 1.0.7)
# plug-ins: KUKA|prc - parametric robot control

# Raccoon KUKA Robot Programming Tutorial
# Robot Motions I
kr90_kr270_r2500 = QuantecKR90KR270R2500Robot(infiniterot=False)
number_slider = Slider(0.52778, range=0..1)
pln = TargetAsPlane(Plane(origin=(1040.197847, 595.5143241, 1682.825624), x=(0.7229242978, 0, -0.6909272462), y=(0, 1, 0)))

# ----
# CIRC
pln_2 = TargetAsPlane(PlaneXY(1093.256099, -873.3130002, 1466.430447))
pln_3 = Plane(Plane(origin=(1040.197847, -346.1112763, 2016.916205), x=(0.7229242978, 0, -0.6909272462), y=(0, 1, 0)))
merge = Merge(Data1=pln_2, Data2=pln_3, Data3=pln)
cir_move = CIRcularMovementKUKAPrc(ArcViaThreePlanes=merge, extaxenabled=False, interpolation="C_DIS")

# ----
# PTP
ptp_move = PTPMovementKUKAPrc(TargetAsPlane=pln, extaxenabled=False, interpolation="C_PTP")

ptp_move_2 = PTPMovementKUKAPrc(TargetAsPlane=PlaneXY(1093.256099, -788.1410093, 1082.333985), extaxenabled=False, interpolation="C_PTP")

# ----
# LIN
lin_move = LINearMovementKUKAPrc(TargetAsPlane=pln, extaxenabled=False, interpolation="C_DIS")

merge_2 = Merge(Data1=ptp_move_2, Data2=ptp_move)
merge_3 = Merge(Data1=ptp_move_2, Data2=lin_move)
merge_4 = Merge(Data1=ptp_move_2, Data2=cir_move)
kuka_prc = KUKAPrcCORE(
    SimulationSlider=number_slider,
    KUKAPrcCommands=merge_2,
    Robot=kr90_kr270_r2500,
    PRC_BaseExpose=False,
    PRC_SaveNameExpose=False,
    PRCsettings="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")  # -> RobotGeometry, AnalysisOutput
kuka_prc_2 = KUKAPrcCORE(
    SimulationSlider=number_slider,
    KUKAPrcCommands=merge_3,
    Robot=kr90_kr270_r2500,
    PRC_BaseExpose=False,
    PRC_SaveNameExpose=False,
    PRCsettings="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")  # -> RobotGeometry, AnalysisOutput
kuka_prc_3 = KUKAPrcCORE(
    SimulationSlider=number_slider,
    KUKAPrcCommands=merge_4,
    Robot=kr90_kr270_r2500,
    PRC_BaseExpose=False,
    PRC_SaveNameExpose=False,
    PRCsettings="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")  # -> RobotGeometry, AnalysisOutput
