# Grasshopper definition 4_robot_motions_II.ghx (Grasshopper 1.0.7)
# plug-ins: KUKA|prc - parametric robot control

crv = Curve(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)
# Raccoon KUKA Robot Programming Tutorial
# Robot Motions II
kr90_kr270_r2500 = QuantecKR90KR270R2500Robot(infiniterot=False)
number_slider = Slider(1, range=0..1)
divide = DivideCurve(Curve=crv, Count=5, Kinks=False)  # -> Points, Tangents, Parameters
yz = YZPlane(Origin=divide.Points)
ptp_move = PTPMovementKUKAPrc(TargetAsPlane=yz, StatusTurn="110", extaxenabled=False, interpolation="C_PTP")
lin_move = LINearMovementKUKAPrc(TargetAsPlane=yz, extaxenabled=False, interpolation="C_DIS")

# ----
# SPL
spl_move = SPLineMovementKUKAPrc(PathAsListOfPlanes=yz, extaxenabled=False, interpolation="C_DIS")

kuka_prc = KUKAPrcCORE(
    SimulationSlider=number_slider,
    KUKAPrcCommands=lin_move,
    Robot=kr90_kr270_r2500,
    PRC_BaseExpose=False,
    PRC_SaveNameExpose=False,
    PRCsettings="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")  # -> RobotGeometry, AnalysisOutput
kuka_prc_2 = KUKAPrcCORE(
    SimulationSlider=number_slider,
    KUKAPrcCommands=ptp_move,
    Robot=kr90_kr270_r2500,
    PRC_BaseExpose=False,
    PRC_SaveNameExpose=False,
    PRCsettings="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")  # -> RobotGeometry, AnalysisOutput
kuka_prc_3 = KUKAPrcCORE(
    SimulationSlider=number_slider,
    KUKAPrcCommands=spl_move,
    Robot=kr90_kr270_r2500,
    PRC_BaseExpose=False,
    PRC_SaveNameExpose=False,
    PRCsettings="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")  # -> RobotGeometry, AnalysisOutput
