# Grasshopper definition 5_robot_motion_III.ghx (Grasshopper 1.0.7)
# plug-ins: KUKA|prc - parametric robot control

# Raccoon KUKA Robot Programming Tutorial
# Multiple Commands
kr90_kr270_r2500 = QuantecKR90KR270R2500Robot(infiniterot=False)
ptp_move = PTPMovementKUKAPrc(TargetAsPlane=PlaneXY(1093.256099, -788.1410093, 1082.333985), extaxenabled=False, interpolation="C_PTP")
lin_move = LINearMovementKUKAPrc(
    TargetAsPlane=Plane(origin=(1040.197847, -788.1410093, 1682.825624), x=(0.7229242978, 0, -0.6909272462), y=(0, 1, 0)),
    extaxenabled=False,
    interpolation="C_DIS")
lin_move_2 = LINearMovementKUKAPrc(
    TargetAsPlane=Plane(origin=(1366.159082, 243.0331, 1840.52289), x=(0.8517408506, 0.5239632844, 0), y=(-0.5239632844, 0.8517408506, 0)),
    extaxenabled=False,
    interpolation="C_DIS")
lin_move_3 = LINearMovementKUKAPrc(
    TargetAsPlane=Plane(origin=(1279.572486, 299.3887203, 1191.222382), x=(0.8002907323, 0, 0.5996121612), y=(0, 1, 0)),
    extaxenabled=False,
    interpolation="C_DIS")
merge = Merge(Data1=lin_move, Data2=ptp_move, Data3=lin_move_2, Data4=lin_move_3)
kuka_prc = KUKAPrcCORE(
    SimulationSlider=Slider(1, range=0..1),
    KUKAPrcCommands=merge,
    Robot=kr90_kr270_r2500,
    PRC_BaseExpose=True,
    PRC_SaveNameExpose=False,
    PRCsettings="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")  # -> RobotGeometry, AnalysisOutput
