# Grasshopper definition 6_IK_vs_FK.ghx (Grasshopper 1.0.7)
# plug-ins: KUKA|prc - parametric robot control

# Raccoon KUKA Robot Programming Tutorial
# Inverse Kinematic v.s. Forward Kinematic
# Inverse Kinematics
kr90_kr270_r2500 = QuantecKR90KR270R2500Robot(infiniterot=False)
# Input
number_slider = Slider(1364, range=-2000..2000)
# Forward Kinematic
number_slider_2 = Slider(44, range=-185..185)
frame = FrameKUKAPrc(
    FrameNumber=0,
    XValue=number_slider,
    YValue=Slider(-1109, range=-2000..2000),
    ZValue=Slider(2000, range=0..2000),
    AValue=Slider(0, range=-180..180),
    BValue=Slider(0, range=-180..180),
    CValue=Slider(0, range=-180..180),
    toolaxis="Z")  # -> KUKAPrcFrame, XYZABCAsPlane
status = ValueList({"000", "001", "010", "011", "100", "101", "110", "111"}, selected="010")
ptp_move = PTPMovementKUKAPrc(TargetAsPlane=frame.XYZABCAsPlane, StatusTurn=status, extaxenabled=False, interpolation="C_PTP")
# III
axis_move = AXISMovementKUKAPrc(
    Axis1=number_slider_2,
    Axis2=Slider(-76.5, range=-140..-5),
    Axis3=Slider(62.3, range=-120..155),
    Axis4=Slider(-76.7, range=-350..350),
    Axis5=Slider(45.8, range=-122.5..122.5),
    Axis6=Slider(69.9, range=-350..350),
    extaxenabled=False,
    interpolation="C_PTP")
kuka_prc = KUKAPrcCORE(
    SimulationSlider=1,
    KUKAPrcCommands=ptp_move,
    Robot=kr90_kr270_r2500,
    PRC_BaseExpose=True,
    PRC_SaveNameExpose=False,
    PRCsettings="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")  # -> RobotGeometry, AnalysisOutput
kuka_prc_2 = KUKAPrcCORE(
    SimulationSlider=1,
    KUKAPrcCommands=axis_move,
    Robot=kr90_kr270_r2500,
    PRC_BaseExpose=True,
    PRC_SaveNameExpose=False,
    PRCsettings="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")  # -> RobotGeometry, AnalysisOutput
analysis = AnalysisKUKAPrc(KUKAPrcAnalysisData=kuka_prc.AnalysisOutput)  # -> simplify(RobotAxisValues), RobotCollisionCheck, RobotReachabilityCheck, CommandID, TimeValue, Planes, CommandTags, IOState, Index, KRL
analysis_2 = AnalysisKUKAPrc(KUKAPrcAnalysisData=kuka_prc_2.AnalysisOutput)  # -> simplify(RobotAxisValues), RobotCollisionCheck, RobotReachabilityCheck, CommandID, TimeValue, simplify(Planes), CommandTags, IOState, Index, KRL
path = ConstructPath(Indices=analysis.Index)
path_2 = ConstructPath(Indices=analysis_2.Index)
branch = TreeBranch(Tree=analysis.RobotAxisValues, Path=path, MaintainPaths=True)
branch_2 = TreeBranch(Tree=analysis_2.Planes, Path=path_2, MaintainPaths=True)
# Output
axis_value = Panel(branch)
# III
# III
# III
frame_2 = Panel(branch_2)
