# Grasshopper definition 7_gh_planes.ghx (Grasshopper 1.0.7)

# Vector Crossproduct
X = UnitX(Factor=1)
Y = UnitY(Factor=1)
# Plane Deconstruct and Re-Construct
yz = YZPlane(Origin=Point(0, 0, 0))
# Raccoon KUKA Robot Programming Tutorial
# GH Planes
# In GH's menu bar, set `Display\Preview Plane Size` to desired dimension.
# Basic Components
xy = XYPlane(Origin=Point(0, 0, 0))
yz_2 = YZPlane(Origin=Point(0, 0, 0))
xz = XZPlane(Origin=Point(0, 0, 0))
# Plane Constructors
pl_3pt = Plane3Pt()
deplane = DeconstructPlane(Plane=yz)  # -> Origin, XAxis, YAxis, ZAxis
xprod = CrossProduct(VectorA=X, VectorB=Y, Unitize=False)  # -> Vector, Length
lnpt = LinePt()
# Ctrl + Alt + Left Click
# to look up a component
Y_2 = UnitY(Factor=1)
X_2 = UnitX(Factor=1)
Z = UnitZ(Factor=1)
Z_2 = UnitZ(Factor=1)
pl = ConstructPlane(Origin=deplane.Origin, XAxis=deplane.ZAxis, YAxis=deplane.YAxis)
# III
lnln = LineLine()
xz_2 = XZPlane(Origin=Point(0, 0, 0))
panel = Panel(Z_2)
# III
panel_2 = Panel(xprod.Vector)
# III
panel_3 = Panel(pl)
# III
panel_4 = Panel(xz_2)
