# Grasshopper definition 8_export_krl.ghx (Grasshopper 1.0.7)
# plug-ins: KUKA|prc - parametric robot control

# Raccoon KUKA Robot Programming Tutorial
# Export KRL
kr90_kr270_r2500 = QuantecKR90KR270R2500Robot(infiniterot=False)
pln = TargetAsPlane(Plane(origin=(1040.197847, 595.5143241, 1682.825624), x=(0.7229242978, 0, -0.6909272462), y=(0, 1, 0)))

# ----
# PTP
ptp_move = PTPMovementKUKAPrc(TargetAsPlane=pln, extaxenabled=False, interpolation="C_PTP")

ptp_move_2 = PTPMovementKUKAPrc(TargetAsPlane=PlaneXY(1093.256099, -788.1410093, 1082.333985), extaxenabled=False, interpolation="C_PTP")
merge = Merge(Data1=ptp_move_2, Data2=ptp_move)
mesh = Mesh(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)

save_krl_file = Button()
robot_prefix = Panel("W")
project_name_abbreviation_max_3_chr = Panel("ABR")
operation_name_max_8_chr = Panel("OPRTN")
python = GhPythonScript(
    robot_prefix=robot_prefix,
    project_abbr=project_name_abbreviation_max_3_chr,
    operation_name=operation_name_max_8_chr,
    SAVE=save_krl_file)  # -> SAVE, NAME; inputs SAVE: Boolean
# ---------- python: Python ----------
from datetime import datetime
import string

robot_prefix = "R" if robot_prefix is None else robot_prefix
project_abbr = "prj" if project_abbr is None else project_abbr
operation_name= "operation" if operation_name is None else operation_name

def remove_invalid_char(a_str):
    valid_chars = "-_%s%s" % (string.ascii_letters, string.digits)
    return ''.join(
        filter(lambda x: x in valid_chars, a_str)
    )


comps=[robot_prefix, project_abbr, operation_name]

for i, comp in enumerate(comps):
    comps[i] = remove_invalid_char(comp)

    
# Prefix=1, project_abbr=3, operation_name=8, timestamp=9
comps[0] = comps[0][:1] if len(comps[0]) > 1 else comps[0]
comps[1] = comps[1][:3] if len(comps[1]) > 3 else comps[1]
comps[2] = comps[2][:8] if len(comps[2]) > 8 else comps[2]
comps.append(datetime.now().strftime("%m%dT%H%M"))

NAME = '_'.join(comps)
# ---------- end python ----------
file_name = Panel(python.NAME)
kuka_prc = KUKAPrcCORE(
    SimulationSlider=Slider(0.80527, range=0..1),
    KUKAPrcCommands=merge,
    Robot=kr90_kr270_r2500,
    CollisionGeometry=mesh,
    SaveToggle=python.SAVE,
    Filename=python.NAME,
    PRC_BaseExpose=False,
    PRC_SaveNameExpose=True,
    PRCsettings="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")  # -> RobotGeometry, AnalysisOutput
